# Grasshopper definition objectName.gh (Grasshopper 1.0.8)
# plug-ins: ChopChop, Bifocals, eleFront

# ---- group: Object name by layer name
crv = Curve([<curve referenced from the Rhino model> x5])
object = ModelObject(Object=flatten(crv))  # -> Object, Geometry, Name, Layer, Visibility, Display, Drafting, Render
panel = Panel(object.Layer)
split = TextSplit(Text=object.Layer, Separators=":")
item = ListItem(List=split, Index=Slider(3, range=0..10), Wrap=True)  # -> flatten(Item)
panel_2 = Panel(item)
rep = ReplaceText(Text=panel_2, Find=" ", RecursiveReplace=False)
object_2 = ModelObject(Object=flatten(crv), Name=flatten(rep))  # -> Object, Geometry, Name, Layer, Visibility, Display, Drafting, Render
cache = ContentCache(Content=object_2.Object)

# ---- group: Group ID by Y position
crv_2 = Curve([<curve referenced from the Rhino model> x24])
midpt = CurveMiddle(Curve=crv_2)
pdecon = Deconstruct(Point=midpt)  # -> XComponent, YComponent, ZComponent
lng = ListLength(List=crv_2)
series = Series(Start=Slider(49, range=0..100), Step=1, Count=lng)
sort = SortList(Keys=pdecon.YComponent, ValuesA=crv_2)  # -> Keys, reverse(ValuesA)
object_3 = ModelObject(Object=flatten(sort.ValuesA), Name=flatten(series))  # -> Object, Geometry, Name, Layer, Visibility, Display, Drafting, Render
panel_3 = Panel(object_3.Object)
cache_2 = ContentCache(Content=object_3.Object)

# ----
chopchop = ChopChop()
# Group
groups = Curve(cache_2)
object_4 = ModelObject(Object=flatten(cache))  # -> Object, Geometry, Name, Layer
sort_2 = SortList(Keys=object_4.Name, ValuesA=cache)  # -> Keys, ValuesA
wheel = ColourWheel(
    Slider(5, range=0..10),
    ColourGrips_Style=31,
    ColourGrips_Grip=[1.161106059, 3.255501162, 5.349896264, 3.141592654],
    ColourGrips_Lum=[0.2223352292, 0.7408419251],
    ColourGrips_Range=[0.2617993878, 0.2617993878, 0.2617993878, 0.2617993878],
    ColourGrips_Sat=[0.530939738, 0.8961665985])
item_2 = ListItem(List=groups, Index=Slider(8, range=0..34), Wrap=True)
# Shore
shores = Curve(sort_2.ValuesA)
toggle = BooleanToggle(False)
ccx = CurveCurve(CurveA=flatten(groups), CurveB=graft(shores))  # -> Points, ParamsA, ParamsB
item_3 = ListItem(List=shores, Index=Slider(4, range=0..4), Wrap=True)
preview = CustomPreview(Material=flatten(wheel))
clean = CleanTree(RemoveNulls=True, RemoveInvalid=True, RemoveEmpty=True, Tree=ccx.Points)
trim = TrimTree(Tree=clean, Depth=1)  # -> simplify(Tree)
ef_att = EleFrontAttributes()  # -> Attributes, Keys, Values, Name, Layer, ColourSource, DisplayColour, MaterialSource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
points = PointList(Points=flatten(clean), Size=Slider(110, range=0..110))

# ---- group: remove earliest shoreline
tstat = TreeStatistics(Tree=trim)  # -> Paths, Length, Count
cull_i = CullIndex(List=tstat.Paths, Indices=Slider(0, range=-1..1), Wrap=Toggle(True))
branch = TreeBranch(Tree=trim, Path=cull_i, MaintainPaths=True)
path_mapper = PathMapper(branch, source="{A}(i)", target="{A-1;i}")

# ---- group: remove first group
cull_i_2 = CullIndex(List=trim, Indices=Slider(0, range=0..100), Wrap=True)
path_mapper_2 = PathMapper(cull_i_2, source="{A;0}(i)", target="{A;i}")

# ---- group: remove last shoreline + first group
tstat_2 = TreeStatistics(Tree=cull_i_2)  # -> Paths, Length, Count
cull_i_3 = CullIndex(List=tstat_2.Paths, Indices=Slider(0, range=-1..1), Wrap=Toggle(True))
branch_2 = TreeBranch(Tree=cull_i_2, Path=cull_i_3, MaintainPaths=True)  # -> simplify(Branch)
path_mapper_3 = PathMapper(branch_2, source="{A}(i)", target="{A-1;i}")

# ---- group: remove last group
cull_i_4 = CullIndex(List=trim, Indices=Slider(-1, range=-1..1), Wrap=True)
path_mapper_4 = PathMapper(cull_i_4, source="{A;0}(i)", target="{A;i}")

# ----
viewer = ParamViewer(trim)
panel_4 = Panel(trim)
viewer_2 = ParamViewer(branch)
viewer_3 = ParamViewer(branch_2)

# ---- group: intersection point debug
number_slider = Slider(22, range=0..100)
item_4 = ListItem(List=flatten(path_mapper_2), Index=number_slider, Wrap=True)
item_5 = ListItem(List=flatten(path_mapper_4), Index=number_slider, Wrap=True)
item_6 = ListItem(List=flatten(path_mapper), Index=number_slider, Wrap=True)
item_7 = ListItem(List=flatten(branch_2), Index=number_slider, Wrap=True)
pt = Point(item_6)
pt_2 = Point(item_4)
pt_3 = Point(item_5)
pt_4 = Point(item_7)

# ----
merge = Merge(Data1=path_mapper_2, Data2=path_mapper_4, Data3=path_mapper, Data4=path_mapper_3)
lng_2 = ListLength(List=merge)

# ---- group: Vertice group debug
tstat_3 = TreeStatistics(Tree=merge)  # -> Paths, Length, Count
item_8 = ListItem(List=tstat_3.Paths, Index=Slider(3, range=0..10), Wrap=True)
branch_3 = TreeBranch(Tree=merge, Path=item_8, MaintainPaths=True)
panel_5 = Panel(branch_3)

# ----
larger = LargerThan(FirstNumber=lng_2, SecondNumber=Slider(4, range=0..10))  # -> LargerThan, OrEqualTo
cull = CullPattern(List=merge, CullPattern=larger.OrEqualTo)
clean_2 = CleanTree(RemoveNulls=True, RemoveInvalid=True, RemoveEmpty=True, Tree=cull)
pline = PolyLine(Vertices=clean_2, Closed=Toggle(True))
boundary = BoundarySurfaces(Edges=pline)
series_2 = Series(Start=Slider(50, range=0..100), Step=1, Count=Slider(22, range=-1..30))
panel_6 = Panel(boundary)
pshift = ShiftPaths(Data=pline, Offset=-1)

# ---- group: polyline debug
item_9 = ListItem(List=flatten(pline), Index=Slider(88, range=0..100), Wrap=True)
crv_3 = Curve(item_9)

# ----
item_10 = ListItem(List=boundary, Index=Slider(1, range=0..1), Wrap=True)
object_5 = ModelObject(Object=pshift, Name=series_2)  # -> Object, Geometry, Name, Layer
panel_7 = Panel(object_5.Object)
colour_l_ab = ColourLAb(Alpha=1, Luminance=0, A=1, B=0.5)
panel_8 = Panel(item_10)
cache_3 = ContentCache(Content=object_5.Object)
flip = FlipMatrix(Data=object_5.Object)
number_slider_2 = Slider(84, range=0..100)
hatch = ModelHatch()  # -> Hatch, Boundary, Plane, HatchPattern, BasePoint, Rotation, Scale, ShowBoundary, Background, FillStyle
object_6 = ModelObject(Object=flip, Name=flip)  # -> Object, Name
swatch = ColourSwatch(SwatchColor=RGB(255, 255, 255))
panel_9 = Panel(object_6.Name)
display_colour = DisplayColour()  # -> DisplayColour, Source, Colour
material = ModelMaterial()  # -> Material, Name, Shader
ghatch = GradientHatch(Colour1=RGB(255, 20, 147), Colour2=RGB(139, 0, 139))
series_3 = Series(Start=0, Step=1, Count=number_slider_2)
wheel_2 = ColourWheel(
    number_slider_2,
    ColourGrips_Style=20,
    ColourGrips_Grip=[5.766468196, 3.389561921, 2.043480631, 5.185073284],
    ColourGrips_Lum=[0.1570317458, 0.5712127357],
    ColourGrips_Range=[0.1852874431, 0.1852874431, 0.1852874431, 0.1852874431],
    ColourGrips_Sat=[0.6096920456, 0.7904931831])
crv_4 = Curve([<curve referenced from the Rhino model> x88])
panel_10 = Panel("""_int2_s1870_e1920
_int3_s1920_e1950
_int4_s1950_e1999
_int5_s1999_e2015""")
split_2 = TextSplit(Text=panel_9, Separators="Model Curve : ")
material_2 = ModelMaterial(Material=wheel_2, Name=series_3)  # -> Material, Name, Shader
panel_11 = Panel(split_2)
preview_2 = CustomPreview(Geometry=[<surface referenced from the Rhino model> x88], Material=material_2.Material)
join = TextJoin(Text=panel_9, Join=panel_10)
object_7 = ModelObject(Object=flip, Name=join)  # -> Object, Geometry, Name, Layer, Visibility, Display, Drafting, Render
clean_3 = CleanTree(RemoveNulls=True, RemoveInvalid=True, RemoveEmpty=True, Tree=split_2)
material_3 = CreateMaterial(Diffuse=RGB(255, 105, 180), Specular=RGB(255, 255, 255), Emission=RGB(0, 0, 0), Transparency=0, Shine=0)
panel_12 = Panel(clean_3)
panel_13 = Panel(join)
panel_14 = Panel(object_7.Object)
cache_4 = ContentCache(Content=object_7.Object)
viewer_4 = ParamViewer(object_7.Object)
