# Grasshopper definition objectName.gh (Grasshopper 1.0.8)
# plug-ins: ChopChop, Bifocals, eleFront

# ---- group: Group ID by Y position
crv = Curve([<curve referenced from the Rhino model> x24])
midpt = CurveMiddle(Curve=crv)
lng = ListLength(List=crv)
pdecon = Deconstruct(Point=midpt)  # -> XComponent, YComponent, ZComponent
series = Series(Start=Slider(49, range=0..100), Step=1, Count=lng)
sort = SortList(Keys=pdecon.YComponent, ValuesA=crv)  # -> Keys, reverse(ValuesA)
object = ModelObject(Object=flatten(sort.ValuesA), Name=flatten(series))  # -> Object, Geometry, Name, Layer, Visibility, Display, Drafting, Render
panel = Panel(object.Object)
cache = ContentCache(Content=object.Object)

# ---- group: Object name by layer name
crv_2 = Curve([<curve referenced from the Rhino model> x5])
object_2 = ModelObject(Object=flatten(crv_2))  # -> Object, Geometry, Name, Layer, Visibility, Display, Drafting, Render
panel_2 = Panel(object_2.Layer)
split = TextSplit(Text=object_2.Layer, Separators=":")
item = ListItem(List=split, Index=Slider(3, range=0..10), Wrap=True)  # -> flatten(Item)
panel_3 = Panel(item)
rep = ReplaceText(Text=panel_3, Find=" ", RecursiveReplace=False)
object_3 = ModelObject(Object=flatten(crv_2), Name=flatten(rep))  # -> Object, Geometry, Name, Layer, Visibility, Display, Drafting, Render

# ----
object_4 = ModelObject(Object=[<geometry referenced from the Rhino model> x19])  # -> Object, Geometry, Name, Layer, Visibility, Display, Drafting, Render
panel_4 = Panel(object_4.Name)
chopchop = ChopChop()
concat = Concatenate(FragmentA=panel_4, FragmentB="_shoreline")
object_5 = ModelObject(Object=object_4.Object, Name=concat)  # -> Object, Geometry, Name, Layer, Visibility, Display, Drafting, Render
cache_2 = ContentCache(Content=object_5.Object)
object_6 = ModelObject(Object=flatten(object_3.Object))  # -> Object, Geometry, Name, Layer
# Shore
sort_2 = SortList(Keys=object_6.Name, ValuesA=object_3.Object)  # -> Keys, ValuesA
wheel = ColourWheel(
    Slider(5, range=0..10),
    ColourGrips_Style=31,
    ColourGrips_Grip=[1.161106059, 3.255501162, 5.349896264, 3.141592654],
    ColourGrips_Lum=[0.2223352292, 0.7408419251],
    ColourGrips_Range=[0.2617993878, 0.2617993878, 0.2617993878, 0.2617993878],
    ColourGrips_Sat=[0.530939738, 0.8961665985])
# Group
groups = Curve(cache)
shores = Curve(sort_2.ValuesA)
ccx = CurveCurve(CurveA=flatten(groups), CurveB=graft(shores))  # -> Points, ParamsA, ParamsB
item_2 = ListItem(List=shores, Index=Slider(4, range=0..4), Wrap=True)
toggle = BooleanToggle(False)
preview = CustomPreview(Material=flatten(wheel))
clean = CleanTree(RemoveNulls=True, RemoveInvalid=True, RemoveEmpty=True, Tree=ccx.Points)
trim = TrimTree(Tree=clean, Depth=1)  # -> simplify(IntersectionPts)
ef_att = EleFrontAttributes()  # -> Attributes, Keys, Values, Name, Layer, ColourSource, DisplayColour, MaterialSource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
points = PointList(Points=flatten(clean), Size=Slider(110, range=0..110))
crv_cp = CurveClosestPoint(Point=trim, Curve=graft(shores))  # -> Point, Parameter, Distance
shatter = Shatter(Curve=graft(shores), Parameters=crv_cp.Parameter)  # -> simplify(Segments)

midpt_2 = CurveMiddle(Curve=shatter)
pdecon_2 = Deconstruct(Point=midpt_2)  # -> XComponent, YComponent, ZComponent
sort_3 = SortList(Keys=pdecon_2.YComponent, ValuesA=shatter)  # -> Keys, reverse(ValuesA)

graft = GraftTree(Tree=sort_3.ValuesA, IncludeEmptyLists=True, IncludeNullItems=True)
tstat = TreeStatistics(Tree=graft)  # -> Paths, Length, Count
item_3 = ListItem(List=tstat.Paths, Index=Slider(79, range=0..88), Wrap=True)
branch = TreeBranch(Tree=graft, Path=item_3, MaintainPaths=True)

tstat_2 = TreeStatistics(Tree=sort_3.ValuesA)  # -> Paths, Length, Count
cull_i = CullIndex(List=tstat_2.Paths, Indices=Slider(0, range=-1..1), Wrap=Toggle(True))
branch_2 = TreeBranch(Tree=sort_3.ValuesA, Path=cull_i, MaintainPaths=True)  # -> simplify(Branch)
tstat_3 = TreeStatistics(Tree=sort_3.ValuesA)  # -> Paths, Length, Count
path_mapper = PathMapper(branch_2, source="{A}", target="{A-1}")
cull_i_2 = CullIndex(List=tstat_3.Paths, Indices=Slider(-1, range=-1..1), Wrap=Toggle(True))
branch_3 = TreeBranch(Tree=sort_3.ValuesA, Path=cull_i_2, MaintainPaths=True)  # -> simplify(graft(Branch))
graft_2 = GraftTree(Tree=path_mapper, IncludeEmptyLists=True, IncludeNullItems=True)
merge = Merge(Data1=branch_3, Data2=graft_2)

# ---- group: remove earliest shoreline
tstat_4 = TreeStatistics(Tree=trim)  # -> Paths, Length, Count
cull_i_3 = CullIndex(List=tstat_4.Paths, Indices=Slider(0, range=-1..1), Wrap=Toggle(True))
branch_4 = TreeBranch(Tree=trim, Path=cull_i_3, MaintainPaths=True)
path_mapper_2 = PathMapper(branch_4, source="{A}(i)", target="{A-1;i}")

# ---- group: remove first group
cull_i_4 = CullIndex(List=trim, Indices=Slider(0, range=0..100), Wrap=True)
path_mapper_3 = PathMapper(cull_i_4, source="{A;0}(i)", target="{A;i}")

# ---- group: remove last shoreline + first group
tstat_5 = TreeStatistics(Tree=cull_i_4)  # -> Paths, Length, Count
cull_i_5 = CullIndex(List=tstat_5.Paths, Indices=Slider(0, range=-1..1), Wrap=Toggle(True))
branch_5 = TreeBranch(Tree=cull_i_4, Path=cull_i_5, MaintainPaths=True)  # -> simplify(Branch)
path_mapper_4 = PathMapper(branch_5, source="{A}(i)", target="{A-1;i}")

# ---- group: remove last group
cull_i_6 = CullIndex(List=trim, Indices=Slider(-1, range=-1..1), Wrap=True)
path_mapper_5 = PathMapper(cull_i_6, source="{A;0}(i)", target="{A;i}")

# ----
loft = Loft(Curves=merge, Options={Adjust=False, Closed=False, LoftEnds=0, LoftSimp=0, LoftType=0, Rebuild=10, Refit=0.01})

number_slider = Slider(68, range=0..100)
wheel_2 = ColourWheel(
    number_slider,
    ColourGrips_Style=20,
    ColourGrips_Grip=[5.448377864, 3.389561921, 2.043480631, 5.185073284],
    ColourGrips_Lum=[0.1570317458, 0.5712127357],
    ColourGrips_Range=[0.1852874431, 0.1852874431, 0.1852874431, 0.1852874431],
    ColourGrips_Sat=[0.6096920456, 0.7904931831])
series_2 = Series(Start=0, Step=1, Count=number_slider)
material = ModelMaterial(Material=wheel_2, Name=series_2)  # -> Material, Name, Shader
preview_2 = CustomPreview(Geometry=flatten(loft), Material=material.Material)

tstat_6 = TreeStatistics(Tree=loft)  # -> Paths, Length, Count
item_4 = ListItem(List=tstat_6.Paths, Index=Slider(19, range=0..88), Wrap=True)
branch_6 = TreeBranch(Tree=loft, Path=item_4, MaintainPaths=True)

pshift = ShiftPaths(Data=loft, Offset=-1)
series_3 = Series(Start=Slider(50, range=0..100), Step=1, Count=Slider(22, range=-1..30))

number_slider_2 = Slider(22, range=0..100)
item_5 = ListItem(List=flatten(path_mapper_3), Index=number_slider_2, Wrap=True)
item_6 = ListItem(List=flatten(path_mapper_5), Index=number_slider_2, Wrap=True)
item_7 = ListItem(List=flatten(path_mapper_2), Index=number_slider_2, Wrap=True)
item_8 = ListItem(List=flatten(branch_5), Index=number_slider_2, Wrap=True)
pt = Point(item_5)
pt_2 = Point(item_6)
pt_3 = Point(item_7)
pt_4 = Point(item_8)

object_7 = ModelObject(Object=pshift, Name=series_3)  # -> Object, Geometry, Name, Layer
merge_2 = Merge(Data1=path_mapper_3, Data2=path_mapper_5, Data3=path_mapper_2, Data4=path_mapper_4)
lng_2 = ListLength(List=merge_2)
flip = FlipMatrix(Data=object_7.Object)
flip_2 = FlipMatrix(Data=object_7.Name)
cache_3 = ContentCache(Content=object_7.Object)
panel_5 = Panel(object_7.Object)
larger = LargerThan(FirstNumber=lng_2, SecondNumber=Slider(4, range=0..10))  # -> LargerThan, OrEqualTo
object_8 = ModelObject(Object=flip, Name=flip_2)  # -> Object, Name
cull = CullPattern(List=merge_2, CullPattern=larger.OrEqualTo)
panel_6 = Panel("""_int2_s1870_e1920
_int3_s1920_e1950
_int4_s1950_e1999
_int5_s1999_e2015""")
panel_7 = Panel(object_8.Name)
clean_2 = CleanTree(RemoveNulls=True, RemoveInvalid=True, RemoveEmpty=True, Tree=cull)

# ---- group: Vertice group debug
tstat_7 = TreeStatistics(Tree=merge_2)  # -> Paths, Length, Count
item_9 = ListItem(List=tstat_7.Paths, Index=Slider(3, range=0..10), Wrap=True)
branch_7 = TreeBranch(Tree=merge_2, Path=item_9, MaintainPaths=True)
panel_8 = Panel(branch_7)

# ----
pline = PolyLine(Vertices=clean_2, Closed=Toggle(True))

item_10 = ListItem(List=flatten(pline), Index=Slider(88, range=0..100), Wrap=True)
crv_3 = Curve(item_10)

concat_2 = Concatenate(FragmentA=panel_7, FragmentB=panel_6)
pshift_2 = ShiftPaths(Data=pline, Offset=-1)
panel_9 = Panel(concat_2)
object_9 = ModelObject(Object=object_8.Object, Name=panel_9)  # -> Object, Geometry, Name, Layer
panel_10 = Panel(object_9.Name)
cache_4 = ContentCache(Content=object_9.Object)
